# Grasshopper definition 301_ur_rtde_extended.ghx (Grasshopper 1.0.7)

crv = Curve(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)
hframes = HorizontalFrames(Curve=crv, Count=10)  # -> Frames, Parameters
info = Info()  # -> info
#   port info: Environment info.
# ---------- info: Python ----------
"""
Displays information about the active COMPAS environment.
"""
import compas_bootstrapper
from ghpythonlib.componentbase import executingcomponent as component

import compas


class CompasInfo(component):
    def RunScript(self):
        self.Message = "COMPAS v{}".format(compas.__version__)
        info = "COMPAS Version: {}\nEnvironment: {}"
        return info.format(compas.__version__, compas_bootstrapper.ENVIRONMENT_NAME)
# ---------- end info ----------
python = GhPythonScript(planes=hframes.Frames)  # -> out, compas_frames; inputs planes: list of Plane
# ---------- python: Python ----------
import Rhino.Geometry as rg
import compas
from compas.geometry import Frame

def plane_to_frame(plane):
    point = plane.Origin.X, plane.Origin.Y, plane.Origin.Z
    compas_frame = Frame(point, plane.XAxis, plane.YAxis)
    return compas_frame

compas_frames = []
for p in planes:
    c_frame = plane_to_frame(p)
    compas_frames.append(c_frame)
# ---------- end python ----------
draw = Draw(cg=python.compas_frames)  # -> rg
#   port cg: The COMPAS geometry or datastructure to be drawn.
#   port rg: The Rhino geometry object.
# ---------- draw: Python ----------
"""
Draws COMPAS geometry in Grasshopper.
"""
from ghpythonlib.componentbase import executingcomponent as component

from compas.artists import Artist


class CompasToRhinoGeometry(component):
    def RunScript(self, cg):
        if not cg:
            return None

        return Artist(cg).draw()
# ---------- end draw ----------
toggle = BooleanToggle(True)
get_config = GhPythonScript(send=Button(), ip="192.168.10.10")  # -> config
# ---------- get_config: Python ----------
import os
from scriptcontext import sticky as st

from compas.rpc import Proxy

config_key = 'config_{}'.format(str(ghenv.Component.InstanceGuid))
if config_key not in st:
    st[config_key] = None

if send:
    canvas = ghenv.Component.OnPingDocument()
    path = os.path.abspath(os.path.dirname(canvas.FilePath))
    rtde = Proxy('fabrication', path=path)
    rtde.restart_server()
    st[config_key] = rtde.get_config(ip=ip)

config = st[config_key]
# ---------- end get_config ----------
move_to_target = GhPythonScript(
    frame=python.compas_frames,
    speed=Slider(0.58, range=0..2),
    accel=Slider(0.1, range=0..3.14),
    send=Button(),
    ip="192.168.10.10")  # -> a
# ---------- move_to_target: Python ----------
import os
import math
import Grasshopper.Kernel as gh
from compas.rpc import Proxy

if send:
    if not frame:
        ghenv.Component.Message = "No frame to move to!"
    else:
        canvas = ghenv.Component.OnPingDocument()
        path = os.path.abspath(os.path.dirname(canvas.FilePath))
        rtde = Proxy('fabrication', path=path)
        radius = 0.1
        a = rtde.move_to_target(frame, speed, accel, 0.1, ip=ip)
        ghenv.Component.Message = "Sent frame"
# ---------- end move_to_target ----------
toggle_freedrive = GhPythonScript(ip="192.168.10.10", start_teach_mode=Toggle(False), stop_teach_mode=Toggle(False))  # -> a
# ---------- toggle_freedrive: Python ----------
import os
import math
import Grasshopper.Kernel as gh
from compas.rpc import Proxy

canvas = ghenv.Component.OnPingDocument()
path = os.path.abspath(os.path.dirname(canvas.FilePath))

if start_teach_mode:
        rtde = Proxy('fabrication', path=path)
        radius = 0.1
        a = rtde.start_teach_mode(ip=ip)
        ghenv.Component.Message = "Freedrive on"

elif stop_teach_mode:
        rtde = Proxy('fabrication', path=path)
        radius = 0.1
        a = rtde.stop_teach_mode(ip=ip)
        ghenv.Component.Message = "Freedrive off"
# ---------- end toggle_freedrive ----------
move_to_target_2 = GhPythonScript(
    frames=python.compas_frames,
    speed=Slider(0.05, range=0..2),
    accel=Slider(0.1, range=0..3.14),
    send=Button(),
    ip="192.168.10.10",
    stop=Button())  # -> a; inputs frames: list
# ---------- move_to_target_2: Python ----------
import os
import math
import Grasshopper.Kernel as gh
from compas.rpc import Proxy


test = False
canvas = ghenv.Component.OnPingDocument()
path = os.path.abspath(os.path.dirname(canvas.FilePath))
rtde = Proxy('fabrication', path=path)
if send:
    if not frames:
        ghenv.Component.Message = "No frame to move to!"
    else:
        radius = 0.1
        a = rtde.move_to_path(frames, speed, accel, 0.05, ip= ip)
        ghenv.Component.Message = "Sent frames"
if stop:
    a = rtde.stop(accel, ip = ip)
elif test:
    canvas = ghenv.Component.OnPingDocument()
    path = os.path.abspath(os.path.dirname(canvas.FilePath))
    rtde = Proxy('fabrication', path=path)
    rtde.restart_server()
    a = rtde.create_path(frames, speed, accel, 0.1)
    print a
# ---------- end move_to_target_2 ----------
panel = Panel(get_config)
panel_2 = Panel(draw)
